# Grasshopper definition gameoflife.gh (Grasshopper 1.0.7)
# plug-ins: ScriptParasite

number_slider = Slider(29, range=0..100)
number_slider_2 = Slider(36, range=0..100)
sqgrid = Square(Plane=PlaneXY(0, 0, 0), Size=1, ExtentX=number_slider_2, ExtentY=number_slider)  # -> Cells, Points
crv = Curve(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)
crv_2 = Curve(<curve referenced from the Rhino model>)
pt = Point(sqgrid.Points)
incurve = PointInCurve(Point=pt, Curve=crv)  # -> Relationship, Point
addition = Addition(A=number_slider_2, B="1")
addition_2 = Addition(A=number_slider, B="1")
equals = Equality(FirstNumber=incurve.Relationship, SecondNumber="2")  # -> Equality, Inequality
cull = CullPattern(List=incurve.Point, CullPattern=equals.Equality)
flatten = FlattenTree(Tree=equals.Equality, Path="{0}")
panel = Panel("""2
3""")
path = FilePath("D:\GitHub\trkRhinoGHcs\scriptparasite\GameOfLife\")

gameoflife = CSharpScript(
    cells=flatten,
    rows=addition,
    columns=addition_2,
    birthRule="2",
    survivalRule=panel,
    run=Toggle(True),
    reset=Toggle(False))  # -> out, A; inputs cells: list of Boolean, rows: Int32, columns: Int32, birthRule: list of Int32, survivalRule: list of Int32, run: Boolean, reset: Boolean
# ---------- gameoflife: C# ----------
            //Sanity
            if (run == false) {
                return;
            }

            if (cells.Count != rows * columns) {
                Component.AddRuntimeMessage(GH_RuntimeMessageLevel.Error, "something weird with dimension of grid");
                return;
            }



            //turn list into 2d array
            bool[,] cellArray = new bool[columns, rows];
            int it = 0;

            for (int j = 0; j < columns; j++) {
                for (int i = 0; i < rows; i++) {
                    cellArray[j, i] = cells[it];
                    it++;
                }
            }
            
            //new array of alive/dead cells for next iteration
            
            bool[,] newCells = new bool[columns, rows];
            for (int j = 0; j < columns; j++) {
                for (int i = 0; i < rows; i++) {
                    bool prevState = cellArray[j, i];
                    
                    //compute alive neighbors
                    int aliveNeighbors = 0;
                    int ni, nj;

                    // topleft
                    ni = i + 1;
                    nj = i - 1;
                    if (ni > rows - 1) ni = 0;
                    else if (ni < 0) ni = rows - 1;
                    if (nj > columns - 1) nj = 0;
                    else if (nj < 0) nj = columns - 1;
                    if(cellArray[nj, ni] == true) aliveNeighbors++;
                }
            }
            
            
            A = cellArray;
            //Print("end of script");
# ---------- end gameoflife ----------
scriptpar = ScriptParasite(Enable=Toggle(True), Folder=path)

panel_2 = Panel(gameoflife.A)
panel_3 = Panel(gameoflife.out)
